# Dynamo graph Shadow.dyn (Dynamo 3.3.0.6316)

select_model_element = DSModelElementSelection()  # 1 picked in the model; graph input
select_site_boundary_elements = DSModelElementsSelection()  # nothing selected
levels = Levels("1FL")  # graph input
string = StringInput("""{
  "solar_parameter_mode": "regulatory_winter_solstice_v1",
  "average_ground_level_elevation_m": 0.0,
  "measurement_height_m": 4.0,
  "solar_declination_deg": -23.439,
  "time_basis": "true_solar_time",
  "sun_time_step_minutes": 30,
  "true_north_deg": 0.0,
  "debug_log_enabled": true,
  "debug_log_dir": "debug_logs",
  "debug_log_filename": "latest_debug.json",
  "preview_mode": "replace",
  "equal_time_contour_preview_mode": "replace"
}""")
regulatory_shadow_preset_日影規制時間 = CustomSelection("標準地域｜条例未確認・候補をすべて表示", items={標準地域｜条例未確認・候補をすべて表示: "standard_all", 標準地域｜5m超～10m以内 3h ／ 10m超 2h: "standard_3_2", 標準地域｜5m超～10m以内 4h ／ 10m超 2.5h: "standard_4_2_5", 標準地域｜5m超～10m以内 5h ／ 10m超 3h: "standard_5_3", 道の区域｜条例未確認・候補をすべて表示: "hokkaido_all", 道の区域｜5m超～10m以内 2h ／ 10m超 1.5h: "hokkaido_2_1_5", 道の区域｜5m超～10m以内 3h ／ 10m超 2h: "hokkaido_3_2", 道の区域｜5m超～10m以内 4h ／ 10m超 2.5h: "hokkaido_4_2_5"}, IsVisibleDropDownTextBlock=true)  # graph input
site_latitude_緯度_deg = DoubleInput("35.6812")  # graph input
site_longitude_経度_deg = DoubleInput("139.7671")  # graph input
calculation_accuracy_計算精度 = CustomSelection("標準｜0.5m・15分", items={高速・ラフ｜0.5m・30分: "rough", 標準｜0.5m・15分: "standard", 高精度｜0.25m・15分: "high"}, IsVisibleDropDownTextBlock=true)  # graph input
python_script = Python(IN[0]=select_model_element, IN[1]=select_site_boundary_elements, IN[2]=levels, IN[3]=string, IN[4]=regulatory_shadow_preset_日影規制時間, IN[5]=site_latitude_緯度_deg, IN[6]=site_longitude_経度_deg, IN[7]=calculation_accuracy_計算精度)  # CPython3
# ---------- python_script.python (144 lines) ----------
# Dynamo Python Node / CPython3
# Emergency checkpoint bootstrap for node-level crash diagnosis.

import os

LOADER_NAME = "dynamo_loader.py"
NODE_BUILD_ID = "2026-07-28-python-node-checkpoint-v1"
_CHECKPOINT_RELATIVE_PATH = "debug_logs/runtime_checkpoint.txt"
checkpoint_path = None
last_checkpoint = None
_pending_checkpoints = []


def _safe_checkpoint_text(value):
    try:
        text = str(value)
    except BaseException:
        text = "<unavailable>"
    text = text.replace("\r", " ").replace("\n", " ")
    return text[:160]


def checkpoint(stage, detail=None, reset=False):
    global last_checkpoint
    try:
        safe_stage = _safe_checkpoint_text(stage)
        safe_detail = None if detail is None else _safe_checkpoint_text(detail)
        last_checkpoint = safe_stage
        if checkpoint_path is None:
            _pending_checkpoints.append((safe_stage, safe_detail, reset))
            return
        mode = "w" if reset else "a"
        with open(checkpoint_path, mode, encoding="utf-8") as stream:
            line = safe_stage
            if safe_detail is not None:
                line += " | " + safe_detail
            stream.write(line + "\n")
            stream.flush()
            os.fsync(stream.fileno())
    except BaseException:
        pass


def _flush_pending_checkpoints():
    global _pending_checkpoints
    try:
        pending = list(_pending_checkpoints)
        _pending_checkpoints = []
        for stage, detail, reset in pending:
            checkpoint(stage, detail, reset)
    except BaseException:
        pass


def _safe_error_text(exc):
    try:
        return _safe_checkpoint_text(exc)
    except BaseException:
        return "<unavailable>"


checkpoint("NODE_ENTER", reset=True)
checkpoint("WORKSPACE_RESOLVE_BEFORE")

try:
    import clr
    clr.AddReference("DynamoServices")
    from Dynamo.Applications import DynamoRevit

    try:
        workspace_file = DynamoRevit.RevitDynamoModel.CurrentWorkspace.FileName
    except BaseException:
        workspace_file = None
    workspace_dir = os.path.dirname(workspace_file) if workspace_file else None
    if workspace_dir:
        checkpoint_path = os.path.join(workspace_dir, _CHECKPOINT_RELATIVE_PATH)
        try:
            os.makedirs(os.path.dirname(checkpoint_path), exist_ok=True)
        except BaseException:
            pass
    _flush_pending_checkpoints()
    checkpoint("WORKSPACE_RESOLVE_AFTER", "ok" if workspace_dir else "none")
    checkpoint("NODE_BUILD_ID", NODE_BUILD_ID)
    checkpoint("CHECKPOINT_FILE_READY", "ok" if checkpoint_path else "none")

    checkpoint("LOADER_PATH_CHECK_BEFORE")
    loader_path = os.path.join(workspace_dir, LOADER_NAME) if workspace_dir else None
    loader_ready = bool(loader_path and os.path.isfile(loader_path))
    checkpoint("LOADER_PATH_CHECK_AFTER", "ok" if loader_ready else "failure")

    if not loader_ready:
        final_out = {
            "success": False,
            "error_code": "python_node_bootstrap_failure",
            "error_type": "FileNotFoundError",
            "error": "dynamo_loader.py not found in the same folder as the .dyn file.",
            "last_checkpoint": last_checkpoint,
            "runtime_checkpoint_file": _CHECKPOINT_RELATIVE_PATH,
        }
    else:
        checkpoint("LOADER_READ_BEFORE")
        with open(loader_path, "r", encoding="utf-8-sig") as stream:
            loader_code = stream.read()
        checkpoint("LOADER_READ_AFTER", "ok")

        checkpoint("LOADER_COMPILE_BEFORE")
        compiled_loader = compile(loader_code, loader_path, "exec")
        checkpoint("LOADER_COMPILE_AFTER", "ok")
        loader_globals = {
            "__file__": loader_path,
            "__name__": "__dynamo_loader__",
            "IN": IN,
            "OUT": None,
            "WORKSPACE_FILE": workspace_file,
            "WORKSPACE_DIR": workspace_dir,
            "LOADER_PATH": loader_path,
            "RUNTIME_CHECKPOINT": checkpoint,
        }
        try:
            loader_globals["UnwrapElement"] = UnwrapElement
        except BaseException:
            pass

        checkpoint("LOADER_EXEC_BEFORE")
        exec(compiled_loader, loader_globals)
        checkpoint("LOADER_EXEC_AFTER", "ok")
        checkpoint("LOADER_OUT_READ_BEFORE")
        final_out = loader_globals.get("OUT", None)
        checkpoint("LOADER_OUT_READ_AFTER", "none" if final_out is None else ("dict" if isinstance(final_out, dict) else "ok"))

except BaseException as exc:
    checkpoint("NODE_EXCEPTION", type(exc).__name__)
    final_out = {
        "success": False,
        "error_code": "python_node_bootstrap_failure",
        "error_type": type(exc).__name__,
        "error": _safe_error_text(exc),
        "last_checkpoint": last_checkpoint,
        "runtime_checkpoint_file": _CHECKPOINT_RELATIVE_PATH,
    }

checkpoint("NODE_OUT_ASSIGN_BEFORE")
OUT = final_out
checkpoint("NODE_RETURN_READY")
# ----------------------------------------
watch = Watch(python_script)  # graph output
