# Dynamo graph DynamoShadow_Forward_PoC.dyn (Dynamo 3.3.0.6316)
# Phase 2 compiled Forward Vertical Slice real-machine proof of concept.

latitudeDeg = DoubleInput("35.6812")
solarDeclinationDeg = DoubleInput("-23.439")
trueNorthDeg = DoubleInput("0.0")
trueSolarStartMinutes = DoubleInput("600.0")
trueSolarEndMinutes = DoubleInput("840.0")
sunTimeStepMinutes = DoubleInput("120.0")
measurementPlaneElevationM = DoubleInput("4.0")
gridResolutionM = DoubleInput("2.0")
analysisMarginM = DoubleInput("2.0")
maxGridPoints = DoubleInput("10000")
contourLevelsMinutes = CodeBlock { [60.0,120.0]; }
footprintXM = CodeBlock { [-2.0,2.0,2.0,-2.0]; }
footprintYM = CodeBlock { [-1.0,-1.0,1.0,1.0]; }
baseZM = DoubleInput("0.0")
topZM = DoubleInput("12.0")
run = DynamoShadow.ForwardVerticalSliceNodes.Run(latitudeDeg=latitudeDeg, solarDeclinationDeg=solarDeclinationDeg, trueNorthDeg=trueNorthDeg, trueSolarStartMinutes=trueSolarStartMinutes, trueSolarEndMinutes=trueSolarEndMinutes, sunTimeStepMinutes=sunTimeStepMinutes, measurementPlaneElevationM=measurementPlaneElevationM, gridResolutionM=gridResolutionM, analysisMarginM=analysisMarginM, maxGridPoints=maxGridPoints, contourLevelsMinutes=contourLevelsMinutes, footprintXM=footprintXM, footprintYM=footprintYM, baseZM=baseZM, topZM=topZM)
watch = Watch(run)
