# Dynamo graph DynamoShadow_PoC.dyn (Dynamo 3.3.0.6316)
# Minimal compiled Dynamo host proof of load.

preset = StringInput("standard")
getGridResolutionMeters = DynamoShadow.AccuracyPresetNodes.GetGridResolutionMeters(presetId=preset)
watch = Watch(getGridResolutionMeters)
