# Dynamo graph Shadow.dyn (Dynamo 3.3.0.6316)

building_model_建物モデル = DSModelElementSelection()  # 1 picked in the model; graph input
site_boundary_area_敷地境界エリア = DSModelElementSelection()  # nothing selected; graph input
average_ground_level_平均地盤面 = Levels("1FL")  # graph input
string = StringInput("""{
  "solar_parameter_mode": "regulatory_winter_solstice_v1",
  "average_ground_level_elevation_m": 0.0,
  "measurement_height_m": 4.0,
  "solar_declination_deg": -23.439,
  "time_basis": "true_solar_time",
  "sun_time_step_minutes": 30,
  "true_north_deg": 0.0,
  "debug_log_enabled": true,
  "debug_log_dir": "debug_logs",
  "debug_log_filename": "latest_debug.json",
  "preview_mode": "replace",
  "equal_time_contour_preview_mode": "replace"
}""")
shadow_limits_日影規制時間_5_10m_10m超 = CustomSelection("Standard / 標準｜All / 全候補", items={Standard / 標準｜All / 全候補: "standard_all", Standard / 標準｜3h / 2h: "standard_3_2", Standard / 標準｜4h / 2.5h: "standard_4_2_5", Standard / 標準｜5h / 3h: "standard_5_3", Hokkaido / 北海道｜All / 全候補: "hokkaido_all", Hokkaido / 北海道｜2h / 1.5h: "hokkaido_2_1_5", Hokkaido / 北海道｜3h / 2h: "hokkaido_3_2", Hokkaido / 北海道｜4h / 2.5h: "hokkaido_4_2_5"}, IsVisibleDropDownTextBlock=true)  # graph input
site_latitude_緯度_deg = DoubleInput("35.6812")  # graph input
site_longitude_経度_deg = DoubleInput("139.7671")  # graph input
calculation_accuracy_計算精度 = CustomSelection("Standard / 標準", items={Fast / 高速: "rough", Standard / 標準: "standard", High / 高精度: "high"}, IsVisibleDropDownTextBlock=true)  # graph input
analysis_mode_解析モード = CustomSelection("Forward Shadow / 順日影", items={Forward Shadow / 順日影: "forward_shadow", Reverse Shadow / 逆日影: "reverse_shadow"}, IsVisibleDropDownTextBlock=true)  # graph input
python_script = Python(IN[0]=building_model_建物モデル, IN[1]=site_boundary_area_敷地境界エリア, IN[2]=average_ground_level_平均地盤面, IN[3]=string, IN[4]=shadow_limits_日影規制時間_5_10m_10m超, IN[5]=site_latitude_緯度_deg, IN[6]=site_longitude_経度_deg, IN[7]=calculation_accuracy_計算精度, IN[8]=analysis_mode_解析モード)  # CPython3
# ---------- python_script.python (144 lines) ----------
# Dynamo Python Node / CPython3
# Emergency checkpoint bootstrap for node-level crash diagnosis.

import os

LOADER_NAME = "dynamo_loader.py"
NODE_BUILD_ID = "2026-07-28-python-node-checkpoint-v1"
_CHECKPOINT_RELATIVE_PATH = "debug_logs/runtime_checkpoint.txt"
checkpoint_path = None
last_checkpoint = None
_pending_checkpoints = []


def _safe_checkpoint_text(value):
    try:
        text = str(value)
    except BaseException:
        text = "<unavailable>"
    text = text.replace("\r", " ").replace("\n", " ")
    return text[:160]


def checkpoint(stage, detail=None, reset=False):
    global last_checkpoint
    try:
        safe_stage = _safe_checkpoint_text(stage)
        safe_detail = None if detail is None else _safe_checkpoint_text(detail)
        last_checkpoint = safe_stage
        if checkpoint_path is None:
            _pending_checkpoints.append((safe_stage, safe_detail, reset))
            return
        mode = "w" if reset else "a"
        with open(checkpoint_path, mode, encoding="utf-8") as stream:
            line = safe_stage
            if safe_detail is not None:
                line += " | " + safe_detail
            stream.write(line + "\n")
            stream.flush()
            os.fsync(stream.fileno())
    except BaseException:
        pass


def _flush_pending_checkpoints():
    global _pending_checkpoints
    try:
        pending = list(_pending_checkpoints)
        _pending_checkpoints = []
        for stage, detail, reset in pending:
            checkpoint(stage, detail, reset)
    except BaseException:
        pass


def _safe_error_text(exc):
    try:
        return _safe_checkpoint_text(exc)
    except BaseException:
        return "<unavailable>"


checkpoint("NODE_ENTER", reset=True)
checkpoint("WORKSPACE_RESOLVE_BEFORE")

try:
    import clr
    clr.AddReference("DynamoServices")
    from Dynamo.Applications import DynamoRevit

    try:
        workspace_file = DynamoRevit.RevitDynamoModel.CurrentWorkspace.FileName
    except BaseException:
        workspace_file = None
    workspace_dir = os.path.dirname(workspace_file) if workspace_file else None
    if workspace_dir:
        checkpoint_path = os.path.join(workspace_dir, _CHECKPOINT_RELATIVE_PATH)
        try:
            os.makedirs(os.path.dirname(checkpoint_path), exist_ok=True)
        except BaseException:
            pass
    _flush_pending_checkpoints()
    checkpoint("WORKSPACE_RESOLVE_AFTER", "ok" if workspace_dir else "none")
    checkpoint("NODE_BUILD_ID", NODE_BUILD_ID)
    checkpoint("CHECKPOINT_FILE_READY", "ok" if checkpoint_path else "none")

    checkpoint("LOADER_PATH_CHECK_BEFORE")
    loader_path = os.path.join(workspace_dir, LOADER_NAME) if workspace_dir else None
    loader_ready = bool(loader_path and os.path.isfile(loader_path))
    checkpoint("LOADER_PATH_CHECK_AFTER", "ok" if loader_ready else "failure")

    if not loader_ready:
        final_out = {
            "success": False,
            "error_code": "python_node_bootstrap_failure",
            "error_type": "FileNotFoundError",
            "error": "dynamo_loader.py not found in the same folder as the .dyn file.",
            "last_checkpoint": last_checkpoint,
            "runtime_checkpoint_file": _CHECKPOINT_RELATIVE_PATH,
        }
    else:
        checkpoint("LOADER_READ_BEFORE")
        with open(loader_path, "r", encoding="utf-8-sig") as stream:
            loader_code = stream.read()
        checkpoint("LOADER_READ_AFTER", "ok")

        checkpoint("LOADER_COMPILE_BEFORE")
        compiled_loader = compile(loader_code, loader_path, "exec")
        checkpoint("LOADER_COMPILE_AFTER", "ok")
        loader_globals = {
            "__file__": loader_path,
            "__name__": "__dynamo_loader__",
            "IN": IN,
            "OUT": None,
            "WORKSPACE_FILE": workspace_file,
            "WORKSPACE_DIR": workspace_dir,
            "LOADER_PATH": loader_path,
            "RUNTIME_CHECKPOINT": checkpoint,
        }
        try:
            loader_globals["UnwrapElement"] = UnwrapElement
        except BaseException:
            pass

        checkpoint("LOADER_EXEC_BEFORE")
        exec(compiled_loader, loader_globals)
        checkpoint("LOADER_EXEC_AFTER", "ok")
        checkpoint("LOADER_OUT_READ_BEFORE")
        final_out = loader_globals.get("OUT", None)
        checkpoint("LOADER_OUT_READ_AFTER", "none" if final_out is None else ("dict" if isinstance(final_out, dict) else "ok"))

except BaseException as exc:
    checkpoint("NODE_EXCEPTION", type(exc).__name__)
    final_out = {
        "success": False,
        "error_code": "python_node_bootstrap_failure",
        "error_type": type(exc).__name__,
        "error": _safe_error_text(exc),
        "last_checkpoint": last_checkpoint,
        "runtime_checkpoint_file": _CHECKPOINT_RELATIVE_PATH,
    }

checkpoint("NODE_OUT_ASSIGN_BEFORE")
OUT = final_out
checkpoint("NODE_RETURN_READY")
# ----------------------------------------
watch = Watch(python_script)  # graph output
